# Grasshopper definition Recursion.ghx (Grasshopper 0.8.52)

angle = Slider(45, range=0..80)
level = Slider(5, range=0..7)
angle_2 = Slider(63, range=0..80)
level_2 = Slider(0, range=0..7)
line = Line(Line((0, 0, 0), (1, 0, 0)))
# GhPython, recursion exercise
# composing the Koch curve
# - learn how to use Python in Grasshopper
# - understand in-function call of self function
# - get to use a little of trigononmetry
# Goals
line_2 = Line(Line((7.332119883, 9.714272554, 0), (37.8370481, 22.62910559, 0)))
python = PythonScript(line=line, angle=angle, maxLevel=level, side=Slider(0.135, range=0.01..0.45), GhMemory=-10)  # -> out, result; disabled
# ---------- python: Python ----------
import rhinoscriptsyntax as rs
import math

def Main():
    global result
    result = []
    SubdivideAndRotate(line, 0, result)

def WeightedAvaragePts(pt1, pt2, pt1_part):
    rest = 1 - pt1_part
    return pt1 * rest + pt2 * pt1_part

def SubdivideAndRotate(line, level, allLines):
    if level == maxLevel:
        allLines.append(line)
        return
    
    start = rs.CurveStartPoint(line)
    end = rs.CurveEndPoint(line)
    second = WeightedAvaragePts(start, end, side)
    third = WeightedAvaragePts(start, end, 1 - side)
    
    middle = WeightedAvaragePts(start, end, 0.5)
    middle = rs.AddPoint(second + (middle - second) / math.cos(angle * math.pi / 180))
    middle = rs.RotateObject(middle, second, angle, [0,0,1], False)
    
    level += 1
    
    SubdivideAndRotate(rs.AddLine(start, second), level, allLines)
    SubdivideAndRotate(rs.AddLine(second, middle), level, allLines)
    SubdivideAndRotate(rs.AddLine(middle, third), level, allLines)
    SubdivideAndRotate(rs.AddLine(third, end), level, allLines)

Main()
# ---------- end python ----------
koch = PythonScript(line=line_2, angle=angle_2, maxLevel=level_2, GhMemory=-10)  # -> out, result
# ---------- koch: Python ----------
import rhinoscriptsyntax as rs
import math

def Main():
    global result
    result = []
    SubdivideAndRotate(line, 0, result)

def WeightedAvaragePts(pt1, pt2, pt1_part):
    rest = 1 - pt1_part
    return pt1 * rest + pt2 * pt1_part

def SubdivideAndRotate(line, level, allLines):
    if level == maxLevel:
        allLines.append(line)
        return
    
    a = rs.CurveStartPoint(line)
    d = rs.CurveEndPoint(line)
    b = WeightedAvaragePts(a, d, 1.0 / 3.0)
    c = WeightedAvaragePts(a, d, 2.0 / 3.0)
    
    m = WeightedAvaragePts(a, d, 0.5)
    bm = m - b
    e = rs.AddPoint(b + (bm / math.cos(angle * math.pi / 180)))
    e = rs.RotateObject(e, b, angle, [0,0,1], False)
    
    level += 1
    
    SubdivideAndRotate(rs.AddLine(a, b), level, allLines)
    SubdivideAndRotate(rs.AddLine(b, e), level, allLines)
    SubdivideAndRotate(rs.AddLine(e, c), level, allLines)
    SubdivideAndRotate(rs.AddLine(c, d), level, allLines)

Main()
# ---------- end koch ----------
