# Grasshopper definition SmoothingPolyline.ghx (Grasshopper 0.8.13)

cycles = Slider(4, range=1..7)
factor = Slider(0.148, range=0..1)
# These scripts smoothen open polylines.
# They are provided it in C#, Python and Vb.Net
# (all the supported languages) so that you can pick.
# 
# Python is the newest entry for Rhino5,
# and you can get the GhPython component
# from food4Rhino. Its implementation is open-source.
pt = Point([Point(-10.3917713, -11.23987661, 0), Point(-23.81430102, -12.02743073, 0), Point(-17.03670365, -21.65023412, 0), Point(-13.24599673, -28.90522197, 0), Point(-18.02255717, -29.47583627, 0), Point(-21.44113398, -30.65696497, 0)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])
pline = PolyLine(Vertices=pt, Closed=False)
# RhinoScript
python = PythonScript(pl=pline, factor=factor, cycles=cycles, GhMemory=0)  # -> out, a; inputs cycles: Int32
# ---------- python: Python ----------
# smoothens a polyline (rhinoscript)
import rhinoscriptsyntax as rs

if rs.IsPolyline(pl): # if pl is polyline
    
    pts = rs.CurvePoints(pl)    # get the polyline vertices
    
    if pts:
        lastPtIndex = len(pts) - 1
        oneLessFactor = 1 - factor
        
        newPts = pts
        while cycles > 0:
            newPts = []              # newPts becomes a new list
            
            for (i, pt) in enumerate(pts):
                if i == 0 or i == lastPtIndex:
                    newPts.append(pt)
                    continue
                
                newPt = (pts[i - 1] + pts[i + 1]) * 0.5
                newPt = newPt * factor + pt * oneLessFactor
                newPts.append(newPt)
            
            pts = newPts            # exchange pts with newPts
            cycles -= 1             # decreases at each cycle
        
        a = newPts
# ---------- end python ----------
# RhinoCommon
python_2 = PythonScript(pl=pline, factor=factor, cycles=cycles, GhMemory=0)  # -> out, a; inputs pl: Polyline, cycles: Int32; disabled
# ---------- python_2: Python ----------
# smoothens a polyline (RhinoCommon)
from Rhino.Collections import Point3dList

if pl: #if pl is different than null
    
    pts = Point3dList(pl) # get the polyline vertices
    
    if len(pts) > 0:
        lastPtIndex = len(pts) - 1
        oneLessFactor = 1 - factor
        
        newPts = pts
        while cycles > 0: # decreases at each cycle
            newPts = [] # newPts becomes a new list
            
            for (i, pt) in enumerate(pts):
                if i == 0 or i == lastPtIndex:
                    newPts.append(pt)
                    continue
                
                newPt = (pts[i - 1] + pts[i + 1]) * 0.5
                newPt = newPt * factor + pt * oneLessFactor
                newPts.append(newPt)
            
            pts = newPts # exchange pts with newPts
            cycles -= 1 # decreases cycles by one
            
        a = newPts
# ---------- end python_2 ----------
c_script = CSharpScript(pl=pline, factor=factor, cycles=cycles)  # -> out, A; inputs pl: Polyline, factor: Double, cycles: Int32; disabled
# ---------- c_script: C# ----------
    // smoothens a polyline
    if (pl != null)                             //if pl is different than null
    {
      List<Point3d> pts = new List<Point3d>(pl); // get the polyline vertices

      if (pts.Count > 0)
      {
        int lastPtIndex = pts.Count - 1;
        double oneLessFactor = 1 - factor;

        List<Point3d> newPts = pts;
        while (cycles-- > 0)            // decreases at each cycle
        {
          newPts = new List<Point3d>(); // newPts becomes a new list

          for (int i = 0; i < pts.Count; i++)
          {
            Point3d pt = pts[i];
            if (i == 0 || i == lastPtIndex)
            {
              newPts.Add(pt);
              continue;
            }

            Point3d newPt = (pts[i - 1] + pts[i + 1]) * 0.5;
            newPt = newPt * factor + pt * oneLessFactor;
            newPts.Add(newPt);
          }

          pts = newPts;                 // exchange pts with newPts
        }

        A = newPts;
      }
    }
# ---------- end c_script ----------
vb = VBScript(pl=pline, factor=factor, cycles=cycles)  # -> out, A; inputs pl: Polyline; disabled
# ---------- vb: VB ----------
    ' smoothens a polyline
    If pl IsNot Nothing Then
      'if pl is different than null
      Dim pts As New List(Of Point3d)(pl)

      ' get the polyline vertices
      If pts.Count > 0 Then

        Dim lastPtIndex As Integer = pts.Count - 1
        Dim oneLessFactor As Double = 1 - factor

        Dim newPts As List(Of Point3d) = pts
        While cycles > 0
          ' decreases at each cycle
          newPts = New List(Of Point3d)()

          ' newPts becomes a new list
          For i As Integer = 0 To pts.Count - 1
            Dim pt As Point3d = pts(i)

            If i = 0 OrElse i = lastPtIndex Then
              newPts.Add(pt)
              Continue For
            End If

            Dim newPt As Point3d = (pts(i - 1) + pts(i + 1)) * 0.5
            newPt = newPt * factor + pt * oneLessFactor
            newPts.Add(newPt)
          Next

          pts = newPts  ' exchange pts with newPts
          cycles -= 1   ' decreases cycles by one
        End While

        A = newPts
      End If
    End If
# ---------- end vb ----------
pline_2 = PolyLine(Vertices=python.a, Closed=False)
pline_3 = PolyLine(Vertices=c_script.A, Closed=False)  # disabled
