# Grasshopper definition quickUpdater.gh (Grasshopper 0.9.62)
# plug-ins: Python Interpreter

crv = Curve(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)
crv_2 = Curve(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)
python = PythonScript(crv=crv_2)  # -> out, pts; inputs crv: Curve
# ---------- python: Python ----------
# mycode

print("Old...")
# ---------- end python ----------
python_2 = PythonScript(crv=crv_2)  # -> out, x, y, z; inputs crv: Curve; same code as python
python_3 = PythonScript(pts=python.pts)  # -> out, x; inputs pts: list
# ---------- python_3: Python ----------
# mycode_v2

print("New Code!")
# ---------- end python_3 ----------
panel = Panel([python.out, python_2.out])

# ---- group: update all (just enable)
x = PythonScript()  # disabled
# ---------- x: Python ----------
import Grasshopper as gh
import scriptcontext as sc

def update(sol, component):
    component.Code = "# mynewcode_v2\n\nprint(\"New Code!\")"
    
    attr = component.Attributes
    if hasattr(attr, 'TryGetEditor'):
        has, ed = attr.TryGetEditor()
        if has: ed.Close()
    
    rem = gh.Kernel.GH_RuntimeMessageLevel.Remark
    component.AddRuntimeMessage(rem, "Hello!")
    component.Message = "v2!"
    
    component.ExpireSolution(True)

def locateAll():
    sol = ghenv.Component.OnPingDocument()
    count = 0
    
    for component in sol.Objects:
        # only ghpython
        if type(component) != type(ghenv.Component): continue
        
        # recognize "my components" by some means
        if not component.Code.startswith("# mycode"): continue
        
        update(sol, component)
        count += 1
    
    if count > 0:
        ghenv.Component.Locked = True
        sol.ScheduleSolution(50)
        ghenv.Component.Message = str(count)

locateAll()
# ---------- end x ----------

# ----
panel_2 = Panel(python_3.out)

# ---- group: updater < one at the time
python_script = PythonScript(port=python_3.x)
# ---------- python_script: Python ----------
import Grasshopper as gh
import scriptcontext as sc
from clr import GetClrType as clrtype


def update(component):
    if "up_last_component" in sc.sticky:
        if sc.sticky["up_last_component"] == component: return
    sc.sticky["up_last_component"] = component
    
    component.Code = "# mycode_v2\n\nprint(\"New Code!\")"
    
    attr = component.Attributes
    if hasattr(attr, 'TryGetEditor'):
        has, ed = attr.TryGetEditor()
        if has: ed.Close()
    
    rem = gh.Kernel.GH_RuntimeMessageLevel.Remark
    component.AddRuntimeMessage(rem, "Hello!")
    component.Message = "v2!"
    
    component.ExpireSolution(True)

ghenv.Component.Message = "connect";

def locateUplink():
    param = ghenv.Component.Params.Input[0]
    sources = param.Sources
    if sources.Count == 0: return
    firstSource = sources[0]
    attr = firstSource.Attributes
    if (attr is None) or (attr.GetTopLevel is None): return
    
    component = attr.GetTopLevel.DocObject
    if (component is None): return
    
    if type(component) != type(ghenv.Component):
        raise Exception("Not a Python component")
    
    if not component.Code.startswith("# mycode"): return
    
    update(component)

locateUplink()
# ---------- end python_script ----------
