# Grasshopper definition test-definition.ghx (Grasshopper 0.8.9)

# RhinoScript
panel = Panel("""from math import sin, cos
import rhinoscriptsyntax as rs

l = inputs.l
ptList = [((cos(i*l),sin(i*l),i*0.4))for i in xrange(0,100)]
rs.AddPoints(ptList)
outputs = doc""")
# Also rather unconventional variable names
# ... are valid
panel_2 = Panel("9.0")
# Retrieving values
# : inputs and outputs are special variable names
# first = inputs.i
# second = inputs.ii
# 
# outputs.a = second
# outputs.b = first
panel_3 = Panel("this is some text")
# first = inputs["requires expl"]
# second = inputs[1] #how else can I write it?
# 
# outputs = first + second
panel_4 = Panel("this is some text")
# Importing normal namespaces
panel_5 = Panel("""import math

a = inputs.i
outputs.a = [math.cos((a + i)/10.0) for i in xrange(20)]""")
# Simple attractors
# ms = [(line.From + line.To) * 0.5 for line in inputs.lines]
# a = inputs.attractor
# f = inputs.strength
# oneLessF = 1 - f
# outputs.mids = [m * f + a * oneLessF for m in ms]
slider = Slider(0, range=0..200)

# ---- group: list access
line = Line([Line((-20, 2, 0), (-13, -9, 0)), Line((-12, 0, 0), (-5, -12, 0)), Line((-2, 12, 0), (-6, 1, 0)), Line((6, 8, 0), (2, 0, 0)), Line((8, -1, 0), (14, -10, 0)), Line((16, -1, 0), (21, -12, 0)), Line((16, 17, 0), (-21, 21, 0)), Line((-17, -17, 0), (20, -16, 0)), Line((26, 13, 0), (27, -18, 0)), Line((-24, -18, 0), (-27, 16, 0))])

# ----
pt = Point(Point(-14, 11, 0))
# ... there is a common document to all the definition.
# Variables are in one scope in the whole document
python = PythonInterpreter(requires_expl=panel_4, Øð=", too", GhMemory=0)  # -> out, Result
#   port Result: The result(s)
# ---------- python: Python ----------
first = inputs["requires expl"]
second = inputs[1] #how else can I write it?

outputs = first + second
# ---------- end python ----------
python_2 = PythonInterpreter(i=panel_3, ii=panel_2, GhMemory=0)  # -> out, a, b
#   port a: The result(s)
#   port b: Variable Data
# ---------- python_2: Python ----------
first = inputs.i
second = inputs.ii

outputs.a = second
outputs.b = first
# ---------- end python_2 ----------
python_3 = PythonInterpreter(Code=panel_5, I=slider, GhMemory=0)  # -> Output, Result
python_4 = PythonInterpreter(lines=line, attractor=pt, strength=Slider(1, range=0..1), GhMemory=0)  # -> out, mids; inputs lines: list
#   port mids: The result(s)
# ---------- python_4: Python ----------
ms = [(line.From + line.To) * 0.5 for line in inputs.lines]
a = inputs.attractor
f = inputs.strength
oneLessF = 1 - f
outputs.mids = [m * f + a * oneLessF for m in ms]
# ---------- end python_4 ----------
panel_6 = Panel(python.Result)
python_5 = PythonInterpreter(Code=panel, L=Slider(0.425, range=0..1), GhMemory=0)  # -> Output, Result
panel_7 = Panel(python_2.b)
panel_8 = Panel(python_2.a)
panel_9 = Panel(python_3.Result)
panel_10 = Panel(python_3.Output)
panel_11 = Panel(python_5.Result)
panel_12 = Panel(python_4.mids)
graph = QuickGraph(python_3.Result)
